# Grasshopper definition ML.gh (Grasshopper 1.0.7)
# Copyright: Arup
# plug-ins: HFTidyCanvas

number_slider = Slider(100, range=0..100)
series = Series(Start=0, Step=1, Count=Slider(1000, range=0..1000))  # -> graft(Series)
python = GhPythonScript(x=series)  # -> out, width, height, rotate
# ---------- python: Python ----------
__author__ = "ismael.sanz"
__version__ = "2020.04.09"

import rhinoscriptsyntax as rs

from random import randint, choice

max = 100

width = []
height = []
rotate = []


for i in range(15):
    width.append(randint(10, max))
    height.append(randint(10, max))
    rotate.append(choice([0,1]))
# ---------- end python ----------
width = DataDescription(python.width)
heigth = DataDescription(python.height)
rotate = DataDescription(python.rotate)
rotate_2 = Rotate(rotate)
rotate_3 = Rotate(rotate_2)
tstat = TreeStatistics(Tree=rotate_3)  # -> Paths, Length, Count
item = ListItem(List=tstat.Paths, Index=0, Wrap=True)
branch = TreeBranch(Tree=rotate_3, Path=item, MaintainPaths=True)
branch_2 = DataDescription(branch)
index = ItemIndex(List=branch_2, Item=branch_2)
width_2 = Width(width)
heigth_2 = Heigth(heigth)
concat = Concatenate(FragmentA="w", FragmentB=index)
concat_2 = Concatenate(FragmentA="h", FragmentB=index)
concat_3 = Concatenate(FragmentA="rot_", FragmentB=index)
merge = Merge(Data1=concat, Data2=concat_2, Data3=concat_3)
merge_2 = Merge(Data1=width_2, Data2=heigth_2, Data3=rotate_2)
headers = DataDescription(merge)
entwine = Entwine(Branch0X=headers, Branch1X=merge_2, FlattenInputs=False)
input = DataDescription(entwine)
python_2 = GhPythonScript(width=width, heigth=heigth, rotate=rotate)  # -> a, width, heigth
# ---------- python_2: Python ----------
if rotate:
    width2 = heigth
    heigth2 = width
    width = width2
    heigth = heigth2
else:
    width = width
    heigth = heigth
# ---------- end python_2 ----------
join = TextJoin(Text=input, Join=",")  # -> flatten(Result)
width_3 = DataDescription(python_2.width)
heigth_3 = DataDescription(python_2.heigth)
addition = Addition(A="20", B=width_3)
ma = MassAddition(Input=addition)  # -> Result, PartialResults
x = DataDescription(ma.PartialResults)
ins = InsertItems(List=x, Item="0", Indices="0", Wrap=True)
cull_i = CullIndex(List=ins, Indices="-1", Wrap=True)
x_2 = DataDescription(cull_i)
width_4 = Width(width_3)
heigth_4 = Heigth(heigth_3)
xy = XYPlane(Origin=Point(0, 0, 0))
x_3 = X(x_2)
width_5 = Width(width_4)
heigth_5 = Heigth(heigth_4)
width_6 = Width(width_4)
x_4 = X(x_2)
heigth_6 = Heigth(heigth_4)
pt = ConstructPoint(XCoordinate=x_3, YCoordinate=0, ZCoordinate=0)
heigth_7 = Heigth(heigth_6)
x_5 = DataDescription(pt)
rectangle = Rectangle(Plane=x_5, XSize=width_5, YSize=heigth_5, Radius=0)  # -> Rectangle, Length
heigth_8 = Rotate(heigth_7)
tstat_2 = TreeStatistics(Tree=heigth_8)  # -> Paths, Length, Count
item_2 = ListItem(List=tstat_2.Paths, Index=0, Wrap=True)
branch_3 = TreeBranch(Tree=heigth_8, Path=item_2, MaintainPaths=True)
branch_4 = DataDescription(branch_3)
index_2 = ItemIndex(List=branch_4, Item=branch_4)
concat_4 = Concatenate(FragmentA="x", FragmentB=index_2)
concat_5 = Concatenate(FragmentA="w", FragmentB=index_2)
concat_6 = Concatenate(FragmentA="h", FragmentB=index_2)
x_6 = X(x_4)
width_7 = Width(width_6)
heigth_9 = Heigth(heigth_7)
merge_3 = Merge(Data1=concat_4, Data2=concat_5, Data3=concat_6)
merge_4 = Merge(Data1=x_6, Data2=width_7, Data3=heigth_9)
headers_2 = DataDescription(merge_3)
entwine_2 = Entwine(Branch0X=headers_2, Branch1X=merge_4, FlattenInputs=False)
input_2 = DataDescription(entwine_2)
join_2 = TextJoin(Text=input_2, Join=",")  # -> flatten(Result)
output = DataDescription(join_2)
button = Button()
output_2 = Output(output)
input_3 = DataDescription(join)
python_3 = GhPythonScript(run=button, x=input_3)  # -> out, a; inputs x: list
# ---------- python_3: Python ----------
import csv
path = r"C:\Users\ismael.sanz\Desktop\ML\input\input.csv"


if run:
    with open (path, "wb") as csv_file:
        writer = csv.writer(csv_file)
        for row in x:
            list_row = row.split(",")
            writer.writerow(list_row)
# ---------- end python_3 ----------
python_4 = GhPythonScript(x=output_2, run=button)  # -> out, a; inputs x: list
# ---------- python_4: Python ----------
import csv
path = r"C:\Users\ismael.sanz\Desktop\ML\input\output.csv"


if run:
    with open (path, "wb") as csv_file:
        writer = csv.writer(csv_file)
        for row in x:
            list_row = row.split(",")
            writer.writerow(list_row)
# ---------- end python_4 ----------
